# Grasshopper definition bake_geomtry.gh (Grasshopper 0.9.76)
# plug-ins: Python Interpreter

box = DomainBox(Base=PlaneXY(0, 0, 0), X=Slider(10, range=0..10), Y=Slider(10, range=0..10), Z=Slider(10, range=0..10))
geo = Geometry(box)
python = PythonScript(G=geo, color=ColourSwatch(SwatchColor=RGB(255, 255, 255)), active=Toggle(True))  # -> out, a
# ---------- python: Python ----------
import rhinoscriptsyntax as rs
import scriptcontext as sc
import Rhino

if active:
    geometry_id = G
    
    doc_object = rs.coercerhinoobject(geometry_id)
    print(type(doc_object))
    
    attributes = doc_object.Attributes
    print('the type of attributes is: ' + str(type(attributes)))
    geometry = doc_object.Geometry
    print('the type of geometry is: ' + str(type(geometry)))
    
    sc.doc = Rhino.RhinoDoc.ActiveDoc
    
    rhino_line = sc.doc.Objects.Add(geometry, attributes)
    print('the Rhino doc ID is: ' + str(rhino_line))
    
    #we put back the original Grasshopper document as default
    sc.doc = ghdoc
# ---------- end python ----------
